# Grasshopper definition 1603420_PEV_Sim_Data.gh (Grasshopper 0.9.76)
# plug-ins: SonicStringDup

number_slider = Slider(0.5, range=0.1..5)
number_slider_2 = Slider(1, range=0.1..5)
number_slider_3 = Slider(1000, range=1..10000)  # disabled
number_slider_4 = Slider(0, range=0..100)  # disabled

# ---- group: RD CRV ONE WAY
crv = Curve(reparameterize([<curve referenced from the Rhino model> x108]))

# ---- group: RD CRV TWO WAY
crv_2 = Curve()

# ----
multiplication = Multiplication(A="24", B="60")
txt = Text("two way")
txt_2 = Text("one way")
panel = Panel(multiplication)
txt_3 = Text("start")
txt_4 = Text("end")

# ---- group: STEP LENGTH
num = Number(Slider(15, range=0..100))

# ----
len = Length(Curve=crv_2)
len_2 = Length(Curve=crv)
dom = ConstructDomain(DomainStart=0, DomainEnd=panel)
division = Division(A=len, B=num)
division_2 = Division(A=len_2, B=num)
random = Random(Range=dom, Number=number_slider_3, Seed=number_slider_4)  # disabled
divlength = DivideLength(Curve=crv_2, Length=num)  # -> Points, Tangents, Parameters
lng = ListLength(List=crv)
lng_2 = ListLength(List=crv_2)
divlength_2 = DivideLength(Curve=crv, Length=num)  # -> Points, Tangents, Parameters
divide = DivideCurve(Curve=crv_2, Count=division, Kinks=False)  # -> Points, Tangents, Parameters
divide_2 = DivideCurve(Curve=crv, Count=division_2, Kinks=False)  # -> Points, Tangents, Parameters
int = Integer(random)  # disabled
range = Range(Domain=dom, Steps=panel)
repeat = RepeatData(Data=txt_3, Length=lng_2)  # -> graft(Data)
repeat_2 = RepeatData(Data=txt_3, Length=lng)  # -> graft(Data)
repeat_3 = RepeatData(Data=txt, Length=lng_2)  # -> graft(Data)
repeat_4 = RepeatData(Data=txt_4, Length=lng_2)  # -> graft(Data)
repeat_5 = RepeatData(Data=txt_2, Length=lng)  # -> graft(Data)
repeat_6 = RepeatData(Data=txt_4, Length=lng)  # -> graft(Data)
pt = Point(divide_2.Points)
pt_2 = Point(divide.Points)

# ---- group: all road pts
pt_3 = Point(flatten([pt, pt_2]))

# ----
lng_3 = ListLength(List=pt_3)
subtraction = Subtraction(A=lng_3, B=1)
dom_2 = ConstructDomain(DomainStart=0, DomainEnd=subtraction)
stringdup = StringDuplicates(String=int)  # -> R, i, P; disabled
shift = ShiftList(List=range, Shift=-1, Wrap=False)
pshift = ShiftPaths(Data=repeat_3, Offset=1)
pshift_2 = ShiftPaths(Data=repeat_4, Offset=1)
pshift_3 = ShiftPaths(Data=repeat_5, Offset=1)
pshift_4 = ShiftPaths(Data=repeat_6, Offset=1)
pshift_5 = ShiftPaths(Data=repeat, Offset=1)
pshift_6 = ShiftPaths(Data=repeat_2, Offset=1)
int_2 = Integer(shift)
sort = SortList(Keys=stringdup.R)  # -> Keys, ValuesA; disabled
xz = XZPlane(Origin=Point(0, 0, 0))
xz_2 = XZPlane(Origin=Point(0, 0, 0))
pshift_7 = ShiftPaths(Data=sort.Keys, Offset=-1)  # disabled
mirror = Mirror(Geometry=pt_2, Plane=xz)  # -> Geometry, Transform
mirror_2 = Mirror(Geometry=pt, Plane=xz_2)  # -> Geometry, Transform
pt_4 = Point(mirror_2.Geometry)
pdecon = Deconstruct(Point=pt_4)  # -> XComponent, YComponent, ZComponent
panel_2 = Panel(pdecon.XComponent)

# ---- group: none dup time
int_3 = Integer(pshift_7)  # disabled

# ----
lng_4 = ListLength(List=int_3)  # disabled
panel_3 = Panel(lng_4)  # disabled
panel_4 = Panel(mirror.Geometry)
panel_5 = Panel(int_3)  # disabled
number_slider_5 = Slider(1000, range=0..1000)
multiplication_2 = Multiplication(A=panel_2, B=number_slider_5)
multiplication_3 = Multiplication(A=pdecon.YComponent, B=number_slider_5)
multiplication_4 = Multiplication(A=pdecon.ZComponent, B=number_slider_5)
int_4 = Integer(multiplication_2)
int_5 = Integer(multiplication_3)
int_6 = Integer(multiplication_4)
division_3 = Division(A=int_4, B=number_slider_5)
division_4 = Division(A=int_5, B=number_slider_5)
division_5 = Division(A=int_6, B=number_slider_5)
panel_6 = Panel(division_3)
graph = GraphMapper(
    int_2,
    x0=0,
    x1=1440,
    y0=0,
    y1=1,
    container_name="Sine Summation",
    Equation0_px=[0.4998726845, 0],
    Equation0_py=[0.1522498727, 0],
    Equation1_px=[0, 0.2534573674],
    Equation1_py=[0.08167254925, 0.3417996764])
rep = ReplaceText(Text=panel_4, Find=", ", Replace=",", RecursiveReplace=False)
pt_5 = ConstructPoint(XCoordinate=panel_6, YCoordinate=division_4, ZCoordinate=division_5)
rep_2 = ReplaceText(Text=rep, Find="{", RecursiveReplace=False)
random_2 = Random(Range=Domain(0, 1), Number=panel, Seed=Slider(0, range=0..100))
pt_6 = Point(pt_5)
panel_7 = Panel(pt_6)
rep_3 = ReplaceText(Text=panel_7, Find=", ", Replace=",", RecursiveReplace=False)
rep_4 = ReplaceText(Text=rep_3, Find="{", RecursiveReplace=False)
rep_5 = ReplaceText(Text=rep_2, Find="}", RecursiveReplace=False)
rep_6 = ReplaceText(Text=rep_4, Find="}", RecursiveReplace=False)
panel_8 = Panel(graph)
panel_9 = Panel(random_2)
panel_10 = Panel(rep_5)
panel_11 = Panel(rep_6)
smaller = SmallerThan(FirstNumber=panel_9, SecondNumber=panel_8)  # -> SmallerThan, OrEqualTo
cull = CullPattern(List=int_2, CullPattern=smaller.OrEqualTo)
pshift_8 = ShiftPaths(Data=cull, Offset=-1)
merge = Merge(Data1=pshift_5, Data2=pshift, Data3=panel_10, Data4=pshift_2)
merge_2 = Merge(Data1=pshift_6, Data2=pshift_3, Data3=panel_11, Data4=pshift_4)

# ---- group: time that has requests
int_7 = Integer(pshift_8)

# ----
lng_5 = ListLength(List=int_7)
random_3 = Random(Range=dom_2, Number=lng_5, Seed=Slider(0, range=0..100))
random_4 = Random(Range=dom_2, Number=lng_5, Seed=Slider(1, range=0..1))
int_8 = Integer(random_4)
int_9 = Integer(random_3)
item = ListItem(List=pt_3, Index=int_8, Wrap=True)
item_2 = ListItem(List=pt_3, Index=int_9, Wrap=True)
pshift_9 = ShiftPaths(Data=item, Offset=-1)
pshift_10 = ShiftPaths(Data=item_2, Offset=-1)

# ---- group: dropoff pts
pt_7 = Point(pshift_9)

# ---- group: pickup pts
pt_8 = Point(pshift_10)

# ----
pdecon_2 = Deconstruct(Point=pt_7)  # -> XComponent, YComponent, ZComponent
pdecon_3 = Deconstruct(Point=pt_8)  # -> XComponent, YComponent, ZComponent
multiplication_5 = Multiplication(A=pdecon_3.XComponent, B=number_slider_5)
multiplication_6 = Multiplication(A=pdecon_3.YComponent, B=number_slider_5)
multiplication_7 = Multiplication(A=pdecon_2.XComponent, B=number_slider_5)
multiplication_8 = Multiplication(A=pdecon_2.YComponent, B=number_slider_5)
int_10 = Integer(multiplication_5)
int_11 = Integer(multiplication_6)
int_12 = Integer(multiplication_7)
int_13 = Integer(multiplication_8)
division_6 = Division(A=int_10, B=number_slider_5)
division_7 = Division(A=int_11, B=number_slider_5)
division_8 = Division(A=int_12, B=number_slider_5)
division_9 = Division(A=int_13, B=number_slider_5)
panel_12 = Panel(division_9)
panel_13 = Panel(division_8)
panel_14 = Panel(division_7)
panel_15 = Panel(division_6)
merge_3 = Merge(Data1=graft(int_7), Data2=graft(panel_15), Data3=graft(panel_14), Data4=graft(panel_13), Data5=graft(panel_12))
join = TextJoin(Text=merge_3, Join=",")
panel_16 = Panel(lng_5)
pshift_11 = ShiftPaths(Data=join, Offset=-1)
flatten = FlattenTree(Tree=merge, Path="{0}")
flatten_2 = FlattenTree(Tree=merge_2, Path="{0}")
panel_17 = Panel(int_7)
pshift_12 = ShiftPaths(Data=pshift_11, Offset=-1)
merge_4 = Merge(Data1=flatten_2, Data2=flatten)
panel_18 = Panel(merge_4)
merge_5 = Merge(Data1="Time,PickupX,PickupY,DropoffX,DropoffY", Data2=pshift_12)
panel_19 = Panel(merge_5)
